vi "Repo 2.gviweb"   [LabVIEW NXG 2.1.0]
panel indicators:
  "Banner Graph": f64[][]
diagram:
  # Place setup code before the loop. For example, perform initial data communication and wire the results into the loop.
  # Top-Level WebVIs usually contain a While Loop that never stops so that they can continue running as long as the web page is open in the user's web browser.
  while {
    # Inside the loop, place code that responds to user input and communicates with data sources over the network.
    for (N = 100) {
      Random Number() -> (number (0 to 1)=w3)
      Random Number() -> (number (0 to 1)=w4)
      append w3 to w1
      append w4 to w2
    }
    Build Array(w1, w2) -> w5
    $"Banner Graph" <- w5
    Wait(time to wait=200)
    stop if FALSE
  }
